# Grasshopper definition Rhino_Grasshopper_101.gh (Grasshopper 0.9.76)

# Draw it in Grasshopper
# Completely in Grasshopper
number_slider = Slider(148, range=0..300)
# How to have something in Grasshopper
crv = Curve(<curve referenced from the Rhino model>)
# Components:
# PlaceHolders
crv_2 = Curve()
# Point, Vector, Plane
# Point:
#   - Location
number_slider_2 = Slider(265, range=0..300)
# Vector:
#   - Orientation
#   - Size
number_slider_3 = Slider(265, range=0..300)
# Plane:
#   - Location
#   - Orientation
number_slider_4 = Slider(250, range=0..300)

# ----
# Exercise One: Draw a Curve and Divide it
# Read Curve From Rhino
# Divide it!
crv_3 = Curve(<curve referenced from the Rhino model>)
divide = DivideCurve(Curve=crv_3, Count=Slider(8, range=0..100), Kinks=False)  # -> Points, Tangents, Parameters

# ----
# Exercise Two: Put 10s of XY planes on a curve
# Read Curve From Rhino
# Divide it!
crv_4 = Curve(<curve referenced from the Rhino model>)
divide_2 = DivideCurve(Curve=crv_4, Count=Slider(71, range=0..100), Kinks=False)  # -> Points, Tangents, Parameters
Z = UnitZ(Factor=1)
xy = XYPlane(Origin=divide_2.Points)
pl = PlaneNormal(Origin=divide_2.Points, ZAxis=Z)

# ----
# Introduce it from Rhino
# Single Object
crv_5 = Curve(<curve referenced from the Rhino model>)
# Multiple Objects
crv_6 = Curve([<curve referenced from the Rhino model> x5])
crv_7 = Curve(<curve referenced from the Rhino model>)
pt = ConstructPoint(XCoordinate=number_slider, YCoordinate=Slider(13, range=0..300), ZCoordinate=Slider(0, range=0..300))
pt_2 = ConstructPoint(XCoordinate=Slider(200, range=0..300), YCoordinate=Slider(54, range=0..300), ZCoordinate=Slider(0, range=0..300))
pt_3 = ConstructPoint(XCoordinate=number_slider_2, YCoordinate=Slider(13, range=0..300), ZCoordinate=Slider(0, range=0..300))
pt_4 = ConstructPoint(XCoordinate=Slider(300, range=0..300), YCoordinate=Slider(77, range=0..300), ZCoordinate=Slider(0, range=0..300))
pt_5 = ConstructPoint(XCoordinate=number_slider_4, YCoordinate=Slider(13, range=0..300), ZCoordinate=Slider(0, range=0..300))
vec = VectorXYZ(XComponent=Slider(207, range=0..300), YComponent=Slider(132, range=0..300), ZComponent=Slider(132, range=0..300))  # -> Vector, Length
# Functions
series = Series(Start=0, Step=1, Count=10)
vec_2 = VectorXYZ(XComponent=number_slider_3, YComponent=Slider(13, range=0..300), ZComponent=Slider(0, range=0..300))  # -> Vector, Length
vec_3 = VectorXYZ(XComponent=Slider(300, range=0..300), YComponent=Slider(77, range=0..300), ZComponent=Slider(0, range=0..300))  # -> Vector, Length
divide_3 = DivideCurve(Curve=crv_7, Count=10, Kinks=False)  # -> Points, Tangents, Parameters
pt_6 = Point(<point referenced from the Rhino model>)
pt_7 = Point(<point referenced from the Rhino model>)
pt_8 = Point([<point referenced from the Rhino model> x7])
panel = Panel(crv_5)
ln = Line(StartPoint=pt, EndPoint=pt_2)
pl_2 = PlaneNormal(Origin=divide_3.Points, ZAxis=vec.Vector)
# Planes are the closest objects to toolpath
pl_3 = PlaneNormal(Origin=pt_5, ZAxis=vec.Vector)
ln_2 = Line(StartPoint=pt_3, EndPoint=pt_4)
vdis = VectorDisplay(Anchor=pt_7, Vector=vec_2.Vector)
vdis_2 = VectorDisplay(Anchor=pt_7, Vector=vec_3.Vector)
vec_4 = VectorXYZ(XComponent=Slider(300, range=0..300), YComponent=Slider(77, range=0..300), ZComponent=Slider(134, range=0..300))  # -> Vector, Length

# ----
# Exercise Three: Put 10s of desired planes on a curve
# Read Curve From Rhino
# Divide it!
crv_8 = Curve(<curve referenced from the Rhino model>)
divide_4 = DivideCurve(Curve=crv_8, Count=Slider(71, range=0..100), Kinks=False)  # -> Points, Tangents, Parameters
xy_2 = XYPlane(Origin=divide_4.Points)
pl_4 = PlaneNormal(Origin=divide_4.Points, ZAxis=vec_4.Vector)

# ----
# Generator
pline = PolyLine(Vertices=pt_8, Closed=Toggle(True))
# Hybrid
pt_9 = Point(<point referenced from the Rhino model>)
pt_10 = Point(<point referenced from the Rhino model>)
pt_11 = Point([<point referenced from the Rhino model> x8])
pt_12 = Point(<point referenced from the Rhino model>)
# Analysis
area = Area(Geometry=pline)  # -> Area, Centroid
panel_2 = Panel(crv_6)
ln_3 = Line(StartPoint=pt_9, EndPoint=pt_10)
ln_4 = Line(StartPoint=pt_11, EndPoint=pt_12)
# Miscellaneous
number_slider_5 = Slider(0.506, range=0..1)
