# Grasshopper definition HAL 101.gh (Grasshopper 0.9.76)
# plug-ins: HAL [Base] Student license [1 Year]. Expires in 183 days., HAL [Robot Library]

# Advanced Configuration
# Robot Defenition
abb_irb2400_m94 = ABBIRB2400M94(NameS="MyRob")  # disabled

crv = Curve(<curve referenced from the Rhino model>)
crv_2 = Curve(<curve referenced from the Rhino model>)
pt = Point(<point referenced from the Rhino model>)
pt_2 = ConstructPoint(
    XCoordinate=Slider(764, range=-1000..10000),
    YCoordinate=Slider(400, range=-1000..1000),
    ZCoordinate=Slider(390, range=0..1000))
polygon = Polygon(Plane=pt_2, Radius=Slider(291, range=-1000..1000), Segments=Slider(10, range=0..10), FilletRadius=0)  # -> Polygon, Length
divide = DivideCurve(Curve=crv_2, Count=Slider(70, range=0..100), Kinks=False)  # -> Points, Tangents, Parameters
disc = Discontinuity(Curve=crv, Level=1)  # -> Points, Parameters
disc_2 = Discontinuity(Curve=polygon.Polygon, Level=1)  # -> Points, Parameters

crv_3 = Curve(<curve referenced from the Rhino model>)  # disabled
crv_4 = Curve(<curve referenced from the Rhino model>)  # disabled
number_slider = Slider(287, range=0..1000)  # disabled
number_slider_2 = Slider(291, range=-1000..1000)  # disabled
number_slider_3 = Slider(9, range=0..10)  # disabled
number_slider_4 = Slider(1000, range=-1000..1000)  # disabled
number_slider_5 = Slider(0, range=-1000..1000)  # disabled
# Toolpath Points
pt_3 = Point(<point referenced from the Rhino model>)  # disabled
pt_4 = ConstructPoint(XCoordinate=number_slider_4, YCoordinate=number_slider_5, ZCoordinate=number_slider)  # disabled
number_slider_6 = Slider(100, range=0..100)  # disabled
polygon_2 = Polygon(Plane=pt_4, Radius=number_slider_2, Segments=number_slider_3, FilletRadius=0)  # -> Polygon, Length; disabled
divide_2 = DivideCurve(Curve=crv_4, Count=number_slider_6, Kinks=False)  # -> Points, Tangents, Parameters; disabled
disc_3 = Discontinuity(Curve=crv_3, Level=1)  # -> Points, Parameters; disabled
disc_4 = Discontinuity(Curve=polygon_2.Polygon, Level=1)  # -> Points, Parameters; disabled

# ----
# Toolpath Points
# Toolpath Orientation
# Generate Toolpath
Y = UnitY(Factor=1)

Z = UnitZ(Factor=1)
multiplication = Multiplication(A=Z, B=-1)
pl = ConstructPlane(Origin=divide.Points, XAxis=Y, YAxis=multiplication)
xy = XYPlane(Origin=disc.Points)
xz = XZPlane(Origin=disc_2.Points)
xy_2 = XYPlane(Origin=pt)

xy_3 = XYPlane(Origin=pt_3)  # disabled
xy_4 = XYPlane(Origin=disc_3.Points)  # disabled
xy_5 = XYPlane(Origin=disc_4.Points)  # disabled

xy_6 = XYPlane(Origin=divide_2.Points)  # disabled
pln = Plane(xy_3)  # disabled
brep = Brep(<brep referenced from the Rhino model>)  # disabled

pln_2 = Plane(xz)
toolpath_creator = ToolpathCreator(Name="MyToolpath", Targets=pln_2, FlipS=-1, RobID=0)

xy_7 = XYPlane(Origin=Point(0, 0, 0))  # disabled
number_slider_7 = Slider(1000, range=0..1000)  # disabled
panel = Panel("Tool01")  # disabled
panel_2 = Panel("Speed100")  # disabled
speed = SpeedPreset(Name=panel_2, TCPVelocity=number_slider_7, ReorientationVelocity=100, Language="ABB RAPID")  # -> Speed, Code; disabled
tool = ToolPreset(
    Name=panel,
    Number=16,
    FixationPlane=xy_7,
    ToolCenterPoint=xy_7,
    OnRobot=True,
    StaticBody=brep,
    DeactivatedColor=RGBA(255, 165, 0, 200),
    ActivatedColor=RGBA(255, 0, 255, 200),
    ActivatedValue=True,
    DOChannelS="DO_12",
    Language="ABB RAPID")  # -> Tool, Code, FixationPlane, TCP, ToolGeometry; disabled
panel_3 = Panel(tool.Code)  # disabled
panel_4 = Panel(speed.Code)  # disabled

mode = ModeValueList({"Code Generation": 0, "Toolpath Preview (t)": 1, "Toolpath Preview (i)": 2}, selected="Toolpath Preview (t)")
modeswitch = ModeSwitch(Mode=mode, TSelect=Slider(0.036, range=0..1), Toolpath=toolpath_creator)  # -> simplify(I), Toolpath, ComputeGeometry, DOTimeline

# ----
# Basic Configuration
# Robot Defenition
# Simulation Mode
# Inverse Kinematics Solver
abb_irb2400_m94_2 = ABBIRB2400M94(NameS="MyRob")
iksolver = InverseKinematicsSolver(
    RobotPreset=abb_irb2400_m94_2,
    Toolpath=modeswitch.Toolpath,
    ComputeGeometry=modeswitch.ComputeGeometry,
    KeepDO=True,
    ErrorDisabled=False,
    LargeReor=90)  # -> JointRotations, OrientedBase, OrientedJoints, OrientedTool, Log, EnvelopeCheck, PathsOut, TotalOut

panel_5 = Panel("MyToolpath")  # disabled
toolpath_creator_2 = ToolpathCreator(Name=panel_5, Targets=pln, Tools=tool.Tool, Speeds=speed.Speed, FlipS=-1, RobID=0)  # disabled

# ----
# Simulation Mode
mode_2 = ModeValueList({"Code Generation": 0, "Toolpath Preview (t)": 1, "Toolpath Preview (i)": 2}, selected="Toolpath Preview (t)")  # disabled
number_slider_8 = Slider(0.947, range=0..1)  # disabled
modeswitch_2 = ModeSwitch(Mode=mode_2, TSelect=number_slider_8, Toolpath=toolpath_creator_2)  # -> simplify(I), Toolpath, ComputeGeometry, DOTimeline; disabled
iksolver_2 = InverseKinematicsSolver(
    RobotPreset=abb_irb2400_m94,
    Toolpath=modeswitch_2.Toolpath,
    ComputeGeometry=modeswitch_2.ComputeGeometry,
    KeepDO=True,
    ErrorDisabled=False,
    LargeReor=90)  # -> JointRotations, OrientedBase, OrientedJoints, OrientedTool, Log, EnvelopeCheck, PathsOut, TotalOut; disabled
panel_6 = Panel(iksolver_2.Log)  # disabled

# ----
# Code Generation
post_processor = PostProcessor(
    JointRotations=iksolver_2.JointRotations,
    Toolpath=modeswitch_2.Toolpath,
    Condensed=False,
    Language="ABB RAPID",
    nRoundC=2,
    nRoundQ=4)  # -> TargetsDeclarations, MotionInstructions, StreamingData, SpeedDeclarations, ZoneDeclarations, ToolDeclarations, WObjDeclaration, CustomCommands; disabled
panel_7 = Panel(post_processor.TargetsDeclarations)  # disabled
panel_8 = Panel(post_processor.MotionInstructions)  # disabled
panel_9 = Panel(post_processor.SpeedDeclarations)  # disabled
panel_10 = Panel(post_processor.ToolDeclarations)  # disabled

panel_11 = Panel("MyModule")  # disabled
quicktask = QuickTask(
    ModuleName=panel_11,
    Declarations=[post_processor.SpeedDeclarations, post_processor.ToolDeclarations],
    TargetsDeclarations=post_processor.TargetsDeclarations,
    ProcedureName="Main",
    Overrides=["ConfJ \Off;", "ConfL \Off;"],
    Operations=post_processor.MotionInstructions,
    Language="ABB RAPID")  # -> Module, Code; disabled
panel_12 = Panel(quicktask.Module)  # disabled
panel_13 = Panel(quicktask.Code)  # disabled
panel_14 = Panel("C:\Users\axb5588\Desktop\admin\codes_")  # disabled
panel_15 = Panel("Code_IRB2400_")  # disabled
button = Button()  # disabled
toggle = BooleanToggle(True)  # disabled
program_exporter = ProgramExporter(Tasks=quicktask.Module, TasksIDs=panel_15, Directory=panel_14, Export=button, Overwrite=toggle, Language="ABB RAPID")  # disabled
panel_16 = Panel(program_exporter)  # disabled
